# Grasshopper definition Thermes_Vals_Peter_zumthor.gh (Grasshopper 1.0.8)

Y = UnitY(Factor="1")
neg = Negative(Value=Y)
line = LineSDL(Start="{0,0,0}", Direction=neg, Length=Slider(0.8, range=0..1))
Z = UnitZ(Factor=Slider(2.3, range=0..10))
extr = Extrude(Base=line, Direction=Z)
pt = Point([Point(15.21716406, 4.862177192, 0), Point(27.51517745, 4.69605809, 0), Point(5.530605102, 5.201498857, 0), Point(41.17137066, 8.944497277, 0), Point(24.20366198, 9.785882089, 0), Point(29.18834415, 19.53248176, 0), Point(25.76701117, 18.84737784, 0), Point(12.00591968, 23.82007766, 0), Point(3.799674286, 21.04712088, 0)])
orient = Orient(Geometry=extr, Source="{0,0,0}", Target=pt)  # -> Geometry, Transform

X = UnitX(Factor="1")
neg_2 = Negative(Value=X)
line_2 = LineSDL(Start="{0,0,0}", Direction=neg_2, Length=Slider(0.5, range=0..1))
Z_2 = UnitZ(Factor=Slider(4.5, range=0..10))
extr_2 = Extrude(Base=line_2, Direction=Z_2)
pt_2 = Point([Point(50.03816846, 1.983727449, 0), Point(49.11314674, 1.983727449, 0), Point(48.08989262, 1.983727449, 0), Point(47.12394073, 1.983727449, 0), Point(46.19073297, 1.983727449, 0), Point(35.2321023, 1.978471723, 0), Point(34.28771887, 1.978471723, 0), Point(25.88357398, 1.983727449, 0), Point(24.9264874, 1.983727449, 0), Point(24.00839324, 1.983727449, 0), Point(23.07923511, 1.983727449, 0), Point(22.05340157, 1.983727449, 0), Point(3.506901445, 1.983727449, 0), Point(2.615054069, 1.983727449, 0), Point(1.639399566, 1.983727449, 0)])
orient_2 = Orient(Geometry=extr_2, Source="{0,0,0}", Target=pt_2)  # -> Geometry, Transform

X_2 = UnitX(Factor="1")
neg_3 = Negative(Value=X_2)
line_3 = LineSDL(Start="{0,0,0}", Direction=neg_3, Length=Slider(0.8, range=0..1))
Z_3 = UnitZ(Factor=Slider(2.3, range=0..10))
extr_3 = Extrude(Base=line_3, Direction=Z_3)
pt_3 = Point([Point(44.21022072, 5.124184222, 0), Point(48.82817307, 6.924026508, 0), Point(45.49275302, 14.76940005, 0), Point(46.46020556, 16.74073553, 0), Point(46.46020556, 19.53554026, 0), Point(46.88965716, 25.28734821, 0), Point(49.83378493, 18.11318428, 0), Point(30.62070284, 8.533790286, 0), Point(36.46358423, 19.6182477, 0), Point(47.18114431, 29.55344142, 0), Point(42.36025736, 28.89890552, 0), Point(39.21681866, 28.89930812, 0), Point(35.86054415, 28.89973799, 0), Point(32.39784912, 28.90018149, 0), Point(28.9351658, 28.89883748, 0), Point(23.3007625, 25.2155461, 0), Point(18.92477204, 25.2155461, 0), Point(21.07993465, 28.90116191, 0), Point(13.59702191, 25.2155461, 0), Point(3.014618035, 25.2155461, 0)])
orient_3 = Orient(Geometry=extr_3, Source="{0,0,0}", Target=pt_3)  # -> Geometry, Transform

crv = Curve(<curve referenced from the Rhino model>)
crv_2 = Curve(<curve referenced from the Rhino model>)
crv_3 = Curve([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])
crv_4 = Curve([<curve referenced from the Rhino model> x3])
srf = Surface(crv)
srf_2 = Surface(crv_2)
srf_3 = Surface(crv_3)
srf_4 = Surface(crv_4)
sdiff = SolidDifference(BrepsA=srf, BrepsB=srf_2)
pt_4 = Point([Point(42.44069589, 1.983727449, 0), Point(32.48251305, 1.983727449, 0), Point(20.31094143, 1.983727449, 0), Point(10.08129203, 1.983727449, 0)])
Z_4 = UnitZ(Factor=Slider(5, range=0..10))
Z_5 = UnitZ(Factor=Slider(5, range=0..10))
Z_6 = UnitZ(Factor=Slider(5, range=0..10))
move = Move(Geometry=pt_4, Motion="{0,0,0.5}")  # -> Geometry, Transform

X_3 = UnitX(Factor="1")
neg_4 = Negative(Value=X_3)
line_4 = LineSDL(Start="{0,0,0.5}", Direction=neg_4, Length=Slider(4.3, range=0..8))
Z_7 = UnitZ(Factor=Slider(4, range=0..10))
extr_4 = Extrude(Base=line_4, Direction=Z_7)
orient_4 = Orient(Geometry=extr_4, Source="{0,0,0.5}", Target=move.Geometry)  # -> Geometry, Transform

pt_5 = Point([Point(16.51130946, 25.2155461, 0), Point(20.96021368, 25.2155461, 0), Point(28.46809263, 19.93438555, 0), Point(43.14779278, 19.6182477, 0), Point(25.63774789, 28.90104731, 0), Point(25.69580729, 25.2155461, 0), Point(26.95249175, 8.533790286, 0), Point(44.9703929, 7.899219891, 0), Point(43.85187371, 23.40050746, 0), Point(43.60510422, 29.55344142, 0), Point(36.80460523, 8.533790286, 0), Point(33.5464486, 19.27282715, 0), Point(20.29182105, 8.822745847, 0), Point(9.074886932, 8.822745847, 0)])

X_4 = UnitX(Factor="1")
neg_5 = Negative(Value=X_4)
line_5 = LineSDL(Start="{0,0,0}", Direction=neg_5, Length=Slider(0.8, range=0..1))
Z_8 = UnitZ(Factor=Slider(2.3, range=0..10))
extr_5 = Extrude(Base=line_5, Direction=Z_8)
orient_5 = Orient(Geometry=extr_5, Source="{0,0,0}", Target=pt_5)  # -> Geometry, Transform

pt_6 = Point([Point(2.473118253, 18.56460017, 0), Point(23.09737799, 17.15683061, 0), Point(24.97556305, 21.65551953, 0), Point(29.18834415, 14.19515824, 0), Point(40.06919148, 16.68433125, 0), Point(45.97933814, 26.34010907, 0)])

Y_2 = UnitY(Factor="1")
neg_6 = Negative(Value=Y_2)
line_6 = LineSDL(Start="{0,0,0}", Direction=neg_6, Length=Slider(0.8, range=0..1))
Z_9 = UnitZ(Factor=Slider(2.3, range=0..10))
extr_6 = Extrude(Base=line_6, Direction=Z_9)
orient_6 = Orient(Geometry=extr_6, Source="{0,0,0}", Target=pt_6)  # -> Geometry, Transform

extr_7 = Extrude(Base=srf_3, Direction=Z_4)
extr_8 = Extrude(Base=srf_4, Direction=Z_6)
extr_9 = Extrude(Base=sdiff, Direction=Z_5)
preview = CustomPreview(Geometry=extr_7, Material=ColourSwatch(SwatchColor=RGBA(138, 138, 138, 143)))
preview_2 = CustomPreview(Geometry=extr_8, Material=ColourSwatch(SwatchColor=RGBA(0, 140, 255, 50)))
preview_3 = CustomPreview(Geometry=extr_9, Material=ColourSwatch(SwatchColor=RGBA(88, 0, 203, 62)))
preview_4 = CustomPreview(Geometry=[orient_2.Geometry, orient_4.Geometry], Material=ColourSwatch(SwatchColor=RGB(107, 164, 207)))
preview_5 = CustomPreview(
    Geometry=[orient_5.Geometry, orient_6.Geometry, orient_3.Geometry, orient.Geometry],
    Material=ColourSwatch(SwatchColor=RGB(0, 0, 0)))
