# Grasshopper definition solid difference.gh (Grasshopper 1.0.8)

crv = Curve([<curve referenced from the Rhino model> x15])
Z = UnitZ(Factor=1)
srf = Surface(crv)
panel = Panel("C:\Users\ramyayoub\Desktop\IAAC\Master\Semester-3\Graph ML -- DOCUMENTS\Graph ML --Ramy\Graph ML -- Assignment\Assignment-02\01-Assets\analysis_plan.dxf")
extr = Extrude(Base=srf, Direction=Z)
neg = Negative(Value=Z)
brep = Brep(<brep referenced from the Rhino model>)
srf_2 = Surface(<surface referenced from the Rhino model>)
move = Move(Geometry=extr, Motion=neg)  # -> Geometry, Transform
geometry = Python3Script(geometry=brep, path=panel, run=Button())  # inputs geometry: Brep
# ---------- geometry: Python ----------
import Rhino
import scriptcontext as sc
import rhinoscriptsyntax as rs

if run:
    # Add brep to doc temporarily
    obj_id = sc.doc.Objects.AddBrep(geometry)
    rs.SelectObject(obj_id)
    
    # Export as DXF
    rs.Command('_-Export "' + path + '" _Enter', False)
    
    # Clean up
    rs.DeleteObject(obj_id)
    print("Exported successfully!")
# ---------- end geometry ----------
sdiff = SolidDifference(BrepsA=srf_2, BrepsB=move.Geometry)
