# Grasshopper definition office building.gh (Grasshopper 1.0.8)

number_slider = Slider(10, range=0..20)
number_slider_2 = Slider(12, range=0..20)
recgrid = Rectangular(Plane=PlaneXY(0, 0, 0), SizeX=number_slider, SizeY=number_slider, ExtentX="6", ExtentY="6")  # -> simplify(graft(Cells)), flatten(Points)
recgrid_2 = Rectangular(Plane=PlaneXY(0, 0, 0), SizeX=number_slider_2, SizeY=number_slider_2, ExtentX="5", ExtentY="5")  # -> simplify(graft(Cells)), flatten(Points)
panel = Panel("""0
30
35
5""")
Z = UnitZ(Factor="2")
panel_2 = Panel(recgrid_2.Cells)
item = ListItem(List=recgrid_2.Points, Index=panel, Wrap=True)
Z_2 = UnitZ(Factor="2")
neg = Negative(Value=Z)
neg_2 = Negative(Value=Z_2)
pline = PolyLine(Vertices=item, Closed=invert(False))
md_slider = MDSlider(
    SliderMode=0,
    slider_value=Point(0.2999624857, 0.1040041585, 0.5),
    x_domain=Domain(0, 1),
    y_domain=Domain(0, 1),
    z_domain=Domain(0, 1))
md_slider_2 = MDSlider(
    SliderMode=0,
    slider_value=Point(0.3045352843, 0.4997700017, 0.5),
    x_domain=Domain(0, 1),
    y_domain=Domain(0, 1),
    z_domain=Domain(0, 1))
extr = Extrude(Base=recgrid.Cells, Direction=neg)
extr_2 = Extrude(Base=recgrid_2.Cells, Direction=neg_2)
cap = CapHoles(Brep=extr)
srf = Surface(pline)
cap_2 = CapHoles(Brep=extr_2)
evalsrf = EvaluateSurface(Surface=reparameterize(srf), Point=[md_slider, md_slider_2])  # -> Point, Normal, UDirection, VDirection, Frame
Y = UnitY(Factor="2")
move = Move(Geometry=evalsrf.Point, Motion=Y)  # -> Geometry, Transform
rectangle = Rectangle(Plane=evalsrf.Point, XSize="-7 to 7", YSize=Domain(-2, 2), Radius=0)  # -> Rectangle, Length
item_2 = ListItem(List=move.Geometry, Index=0, Wrap=True)
boxrec = BoxRectangle(Rectangle=rectangle.Rectangle, Height="30")
item_3 = ListItem(List=boxrec, Index=0, Wrap=True)  # -> Item, Item1
debrep = DeconstructBrep(Brep=item_3.Item1)  # -> Faces, Edges, Vertices
item_4 = ListItem(List=debrep.Faces, Index=0, Wrap=True)
project = Project(Geometry=item_2, Plane=item_4)  # -> Geometry, Transform
Y_2 = UnitY(Factor="4")
move_2 = Move(Geometry=project.Geometry, Motion=Y_2)  # -> Geometry, Transform
line = LineSDL(Start=move_2.Geometry, Direction="{0,1,0}", Length="20")
ln = Line(StartPoint=item_2, EndPoint=project.Geometry)
merge = Merge(Data1=line, Data2=ln)
Z_3 = UnitZ(Factor="5")
X = UnitX(Factor="4")
move_3 = Move(Geometry=merge, Motion=Z_3)  # -> Geometry, Transform
neg_3 = Negative(Value=X)
move_4 = Move(Geometry=graft(merge), Motion=[X, neg_3])  # -> Geometry, Transform
X_2 = UnitX(Factor="1.75")
X_3 = UnitX(Factor="1.75")
divide = DivideCurve(Curve=move_3.Geometry, Count="5", Kinks=False)  # -> Points, Tangents, Parameters
neg_4 = Negative(Value=X_3)
divide_2 = DivideCurve(Curve=move_4.Geometry, Count="5", Kinks=False)  # -> simplify(Points), Tangents, Parameters
pline_2 = PolyLine(Vertices=divide.Points, Closed=False)
move_5 = Move(Geometry=move_3.Geometry, Motion=X_2)  # -> Geometry, Transform
move_6 = Move(Geometry=move_3.Geometry, Motion=neg_4)  # -> Geometry, Transform
explode = Explode(Curve=pline_2, Recursive=True)  # -> Segments, Vertices
subset = SubList(List=divide_2.Points, Domain="1 to 4", Wrap=True)  # -> List, Index
end = EndPoints(Curve=move_3.Geometry)  # -> Start, End
rulesrf = RuledSurface(CurveA=move_5.Geometry, CurveB=move_6.Geometry)
X_4 = UnitX(Factor="1.75")
X_5 = UnitX(Factor="8")
pt = Point(end.End)
item_5 = ListItem(List=pt, Index=0, Wrap=True)
move_7 = Move(Geometry=explode.Segments, Motion=X_4)  # -> Geometry, Transform
move_8 = Move(Geometry=explode.Segments, Motion=X_5)  # -> Geometry, Transform
rectangle_2 = Rectangle(Plane=subset.List, XSize="-0.3 to 0.3", YSize="-0.3 to 0.3", Radius=0)  # -> Rectangle, Length
rectangle_3 = Rectangle(Plane=item_5, XSize=Slider(6.5, range=0..10), YSize="5", Radius=0)  # -> Rectangle, Length
rulesrf_2 = RuledSurface(CurveA=move_7.Geometry, CurveB=move_8.Geometry)
Z_4 = UnitZ(Factor=Slider(3, range=0..25))
X_6 = UnitX(Factor="6.5")
extr_3 = Extrude(Base=rulesrf, Direction=Z_4)
Z_5 = UnitZ(Factor="3")
neg_5 = Negative(Value=X_6)
extr_4 = Extrude(Base=rulesrf_2, Direction=Z_5)
move_9 = Move(Geometry=rectangle_3.Rectangle, Motion=neg_5)  # -> Geometry, Transform
series = Series(Start=0, Step=Slider(3, range=0..10), Count=Slider(8, range=0..10))
series_2 = Series(Start=0, Step=Slider(3, range=0..10), Count=Slider(8, range=0..10))
srf_2 = Surface([move_9.Geometry, rectangle_3.Rectangle])
Z_6 = UnitZ(Factor="3")
Z_7 = UnitZ(Factor=series)
series_3 = Series(Start=0, Step=Slider(3, range=0..10), Count=Slider(8, range=0..10))
Z_8 = UnitZ(Factor=series_2)
extr_5 = Extrude(Base=srf_2, Direction=Z_6)
Z_9 = UnitZ(Factor=series_3)
X_7 = UnitX(Factor=Slider(9.75, range=0..10))
move_10 = Move(Geometry=graft(extr_3), Motion=Z_7)  # -> Geometry, Transform
move_11 = Move(Geometry=graft(extr_4), Motion=Z_8)  # -> Geometry, Transform
boxrec_2 = BoxRectangle(Rectangle=rectangle_2.Rectangle, Height="5")
neg_6 = Negative(Value=X_7)
move_12 = Move(Geometry=move_11.Geometry, Motion=neg_6)  # -> Geometry, Transform
move_13 = Move(Geometry=graft(extr_5), Motion=Z_9)  # -> Geometry, Transform
